# Grasshopper definition R2a.DeleteAll-Sheets-Except-Originals-ver02.ghx (Grasshopper 1.0.8)
# plug-ins: Rhino.Inside for Autodesk Revit, SAM.Core.Grasshopper.Revit

model = ModelCategoriesPicker({"Abutments": -2006130, "Air Systems": -2001008, "Air Terminals": -2008013, "Analysis Display Style": -2000304, "Analysis Results": -2000303, "Areas": -2003200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}, selected="Sheets": -2003100)
category_filter = CategoryFilter(Categories=model, Inverted=False)
query_views = QueryViews(IsTemplate=False, IsAssembly=False, IsPrintable=True, Filter=category_filter)
element_passport = ElementPassport(Element=query_views)  # -> DocumentGUID, Document, UniqueID, Id
panel = Panel("""725518
725533
802983
805316
835480
1007139
1008572""")
text = Text(element_passport.Id)
member_index = MemberIndex(Set=text, Member=flatten(panel))  # -> flatten(Index), Count
cull_index = CullIndex(List=query_views, Indices=member_index.Index, Wrap=True)
panel_2 = Panel(cull_index)
button = Button()
samcore_deleteelement = SAMCoreDeleteElement(_elements=cull_index, _run=Toggle(True), SAM_ComponentVersion="1.0.1")
