# Grasshopper definition R3.TagWalls-ver02.ghx (Grasshopper 1.0.8)
# plug-ins: Rhino.Inside for Autodesk Revit, SAM.Core.Grasshopper.Revit

# ---- group: Not Curtain Walls
sam_core_wallkind = SAMCoreWallKind(WallKind=1, SAM_ComponentVersion="1.0.0", SAM_SAMVersion="v20210215.1")
samcore_getwalls = SAMCoreGetWalls(_wallKinds=sam_core_wallkind, _inverted=Toggle(True), SAM_ComponentVersion="1.0.0", SAM_SAMVersion="v20210215.1")

# ---- group: Curtain
sam_core_wallkind_2 = SAMCoreWallKind(WallKind=1, SAM_ComponentVersion="1.0.0", SAM_SAMVersion="v20210215.1")
samcore_getwalls_2 = SAMCoreGetWalls(_wallKinds=sam_core_wallkind_2, _inverted=False, SAM_ComponentVersion="1.0.0", SAM_SAMVersion="v20210215.1")

# ----
number_slider = Slider(1, range=0..1)
_1_5_m_min_lentgt_for_tag = Panel("1.5")
element_parameter = ElementParameter(Element=samcore_getwalls_2, Parameter="Length")  # -> Element, Value
element_parameter_2 = ElementParameter(Element=samcore_getwalls, Parameter="Length")  # -> Element, Value
anno_tag_sam_curtainwall = ElementTypePicker({"Anno_Tag_SAM_CurtainWall : Standard": "4d33be9d-9970-485a-996f-b3cf97924544:6c0b39d8-0d37-4f43-8941-b826f64e1f9c-000cd85c"}, selected="Anno_Tag_SAM_CurtainWall : Standard")
larger = LargerThan(FirstNumber=element_parameter.Value, SecondNumber=_1_5_m_min_lentgt_for_tag)  # -> LargerThan, OrEqualTo
larger_2 = LargerThan(FirstNumber=element_parameter_2.Value, SecondNumber=_1_5_m_min_lentgt_for_tag)  # -> LargerThan, OrEqualTo
anno_tag_sam_wall = ElementTypePicker({"Anno_Tag_SAM_Wall : Standard": "4d33be9d-9970-485a-996f-b3cf97924544:85bd20c8-aefd-4e77-9d94-d5590b09affa-000bd87f"}, selected="Anno_Tag_SAM_Wall : Standard")
dispatch = Dispatch(List=samcore_getwalls_2, DispatchPattern=larger.LargerThan)  # -> ListA, ListB
dispatch_2 = Dispatch(List=samcore_getwalls, DispatchPattern=larger_2.LargerThan)  # -> ListA, ListB
element_passport = ElementPassport(Element=[anno_tag_sam_wall, anno_tag_sam_curtainwall])  # -> DocumentGUID, Document, UniqueID, Id
panel = Panel("""776319
841820""")
integer = Integer(panel)
entwine = Entwine(Branch00=dispatch_2.ListA, Branch01=dispatch.ListA, FlattenInputs=True)  # -> simplify(Result)
partition = PartitionList(List=integer, Size=1)  # -> simplify(Chunks)
param_viewer = ParamViewer(entwine)
samcore_tagelements = SAMCoreTagElements(
    _templateNames="Heating Load",
    _tagType=partition,
    _elements=entwine,
    _addLeader_=False,
    _horizontal_=True,
    _viewTypes_="FloorPlan",
    _run=Toggle(True),
    SAM_ComponentVersion="1.0.1")
