# Grasshopper definition R4.TagWindows-ver02.ghx (Grasshopper 1.0.8)
# plug-ins: Rhino.Inside for Autodesk Revit, SAM.Core.Grasshopper.Revit

anno_tag_sam_curtainwall = ElementTypePicker({"Anno_Tag_SAM_CurtainWall : Standard": "4d33be9d-9970-485a-996f-b3cf97924544:6c0b39d8-0d37-4f43-8941-b826f64e1f9c-000cd85c"}, selected="Anno_Tag_SAM_CurtainWall : Standard")  # disabled

# ---- group: Not Curtain Walls
toggle = BooleanToggle(False)  # disabled
sam_core_wallkind = SAMCoreWallKind(WallKind=1, SAM_ComponentVersion="1.0.0", SAM_SAMVersion="v20210215.1")  # disabled
samcore_getwalls = SAMCoreGetWalls(_wallKinds=sam_core_wallkind, _inverted=toggle, SAM_ComponentVersion="1.0.0", SAM_SAMVersion="v20210215.1")  # disabled

# ----
anno_tag_sam_wall = ElementTypePicker({"Anno_Tag_SAM_Wall : Standard": "4d33be9d-9970-485a-996f-b3cf97924544:85bd20c8-aefd-4e77-9d94-d5590b09affa-000bd87f"}, selected="Anno_Tag_SAM_Wall : Standard")  # disabled

# ---- group: Curtain
sam_core_wallkind_2 = SAMCoreWallKind(WallKind=1, SAM_ComponentVersion="1.0.0", SAM_SAMVersion="v20210215.1")  # disabled
samcore_getwalls_2 = SAMCoreGetWalls(_wallKinds=sam_core_wallkind_2, _inverted=False, SAM_ComponentVersion="1.0.0", SAM_SAMVersion="v20210215.1")  # disabled

# ----
number_slider = Slider(1, range=0..1)  # disabled
query_categories = QueryCategories(Type=1, Name="Windows", IsVisibleUI=True, IsSubcategory=False)
query_categories_2 = QueryCategories(Type=1, Name="Doors", IsVisibleUI=True, IsSubcategory=False)
panel = Panel("Length")  # disabled
_1_5_m_min_lentgt_for_tag = Panel("1.5")  # disabled
component_families_picker = ComponentFamiliesPicker(<component families picker referenced from the Revit model>, SearchPattern="Window")
component_families_picker_2 = ComponentFamiliesPicker(<component families picker referenced from the Revit model>, SearchPattern="Door")
anno_tag_sam_window = ElementTypePicker({"Anno_Tag_SAM_Window : Standard": "4d33be9d-9970-485a-996f-b3cf97924544:85bd20c8-aefd-4e77-9d94-d5590b09affa-000bd3c9"}, selected="Anno_Tag_SAM_Window : Standard")
anno_tag_sam_door = ElementTypePicker({"Anno_Tag_SAM_Door : Standard": "4d33be9d-9970-485a-996f-b3cf97924544:85bd20c8-aefd-4e77-9d94-d5590b09affa-000bd4b7"}, selected="Anno_Tag_SAM_Door : Standard")
category_filter = CategoryFilter(Categories=query_categories, Inverted=False)
category_filter_2 = CategoryFilter(Categories=query_categories_2, Inverted=False)
getparam = GetElementParameter(Element=samcore_getwalls_2, ParameterKey=panel)  # disabled
element = Element(anno_tag_sam_wall)  # disabled
element_2 = Element(anno_tag_sam_curtainwall)  # disabled
getparam_2 = GetElementParameter(Element=samcore_getwalls, ParameterKey=panel)  # disabled
merge = Merge(Data1=element_2, Data2=element)  # disabled
query_elements = QueryElements(Filter=category_filter_2, Limit=100)  # -> Elements, Count
query_elements_2 = QueryElements(Filter=category_filter, Limit=100)  # -> Elements, Count
larger = LargerThan(FirstNumber=getparam, SecondNumber=_1_5_m_min_lentgt_for_tag)  # -> LargerThan, OrEqualTo; disabled
element_passport = ElementPassport(Element=[anno_tag_sam_window, anno_tag_sam_door])  # -> DocumentGUID, Document, UniqueID, Id
panel_2 = Panel(component_families_picker)
panel_3 = Panel("""775113
775351""")
larger_2 = LargerThan(FirstNumber=getparam_2, SecondNumber=_1_5_m_min_lentgt_for_tag)  # -> LargerThan, OrEqualTo; disabled
toggle_2 = BooleanToggle(False)
integer = Integer(panel_3)
entwine = Entwine(Branch00=query_elements_2.Elements, Branch01=query_elements.Elements, FlattenInputs=True)  # -> simplify(Result)
dispatch = Dispatch(List=samcore_getwalls, DispatchPattern=larger_2.LargerThan)  # -> ListA, ListB; disabled
partition = PartitionList(List=integer, Size=1)  # -> simplify(Chunks)
dispatch_2 = Dispatch(List=samcore_getwalls_2, DispatchPattern=larger.LargerThan)  # -> ListA, ListB; disabled
param_viewer = ParamViewer(entwine)
samcore_tagelements = SAMCoreTagElements(
    _templateNames="Heating Load",
    _tagType=partition,
    _elements=entwine,
    _addLeader_=False,
    _horizontal_=True,
    _viewTypes_="FloorPlan",
    _run=Toggle(True),
    SAM_ComponentVersion="1.0.1")
